# Grasshopper definition Agripv_Mobile_ SimuSimp.gh (Grasshopper 1.0.7)

# Dossier de stockage des simulations.
# bien vérifier qu'ile xiste un dossier pour chaque angle de -60 à 60, nommer par leur angle seuls.
# Puis coler le chemin d'accès au dossier référencer en tant que "ANGLE" ci contre :
panel = Panel("C:\Users\maceo.valente\Documents\Automatisation\TEST_MVA\ANGLE")
# Indiquer les cacracétistiques structurelle du projet :
# 1 . L'orientation des panneaux selon l'axe des rang ( N =0, S =180, E 90, O -90)
# 2. La hauteur de l'axe d'attache des panneaux
# 3. L'entraxe PV
# 4. La taille du rampant.
orientation = Slider(30, range=-180..180)

# ----
# Orientation parcelle
radians = Radians(Degrees=orientation)
# Faire tourner l'axe y autour de l'axe z avec les degrés correspondant à l'orientationd de la parcelle
xy_plane = XYPlane(Origin=Point(0, 0, 0))
unit_z = UnitZ(Factor=1)
deconstruct_plane = DeconstructPlane(Plane=xy_plane)  # -> Origin, XAxis, YAxis, ZAxis
rotate = Rotate(Vector=deconstruct_plane.YAxis, Axis=unit_z, Angle=radians)

hauteur_en_m = Slider(3, range=0..100)
entraxe_pv = Slider(2.5, range=0..10)
# Avant de lancer la simulation.
# Bien vérifier la validiter :
# - du fichier météo
# - du format de la structure sur le volet 3D
# - =des caracétristiques projets
# - du fichier de dépôt des simulation sous le format ".../ANGLE/".
# 
# Attention, lors de la première simulation le contenu peut être bloqué par le système interne, il faut alors débloquer le contenu sur la fenètre qui s'affiche une fois la simulation lancée et eventuellement la relancer.
rampant_en_m = Slider(1.134, range=0..10)
# Référencer le fichier météo epw .
# 1. Clic droit sur "File Path"
# 2. Cliquer sur "Select existing file"
# 3. Selectionner le fichier epw ranger dans le dossier projet
# 4.Puis cliquer sur ouvrir
file_path = FilePath("C:\Users\maceo.valente\Documents\Automatisation\TEST_MVA\FRA_AC_Agen-La.Garenne.AP.075240_TMYx\FRA_AC_Agen-La.Garenne.AP.075240_TMYx.epw")
lancement_de_la_simulation_de_lumière = BooleanToggle(False)

# ----
# Taux de couverture
number_slider = Slider(20, range=0..100)
# créer une surface dans rhino ?
surface = Surface(<surface referenced from the Rhino model>)
rotate_2 = Rotate(Geometry=surface, Angle=radians, Plane=xy_plane)  # -> Geometry, Transform
division = Division(A="100", B=entraxe_pv)
unit_z_2 = UnitZ(Factor=hauteur_en_m)
divide_surface = DivideSurface(Surface=rotate_2.Geometry, UCount=division, VCount=number_slider)  # -> Points, Normals, Parameters
move = Move(Geometry=divide_surface.Points, Motion=unit_z_2)  # -> Geometry, Transform
construct_plane = ConstructPlane(Origin=move.Geometry, XAxis=Vector(1, 0, 0), YAxis=Vector(0, 1, 0))
align_plane = AlignPlane(Plane=construct_plane, Direction=rotate)  # -> Plane, Angle

pt = Point([Point(46.12704233, 53.60679109, 0), Point(43.51246929, 53.33179617, 0), Point(41.28702096, 55.36144043, 0), Point(40.41641684, 58.14642024, 0), Point(41.46466262, 60.67940974, 0), Point(43.43241225, 61.19147041, 0), Point(45.45053531, 60.5006384, 0), Point(47.03510891, 59.52075576, 0), Point(47.85878826, 57.41053356, 0), Point(47.77166733, 56.1457418, 0), Point(47.50573365, 54.92928969, 0), Point(46.81827275, 54.0134336, 0)])
panel_2 = Panel(pt)
srfgrid = SurfaceFromPoints(Points=pt, UCount="6", Interpolate=Toggle(True))

deplane = DeconstructPlane(Plane=align_plane.Plane)  # -> Origin, XAxis, YAxis, ZAxis
rad = Radians(Degrees=Slider(48, range=-60..60))
# Orientation autour de l'axe Y
construct_plane_2 = ConstructPlane(Origin=deplane.Origin, XAxis=deplane.ZAxis, YAxis=deplane.YAxis)
rotate_3 = Rotate(Geometry=align_plane.Plane, Angle=rad, Plane=construct_plane_2)  # -> Geometry, Transform

# ----
# Création et remplissage et taille des panneaux
number_slider_2 = Slider(5, range=0..100)
rectangle = Rectangle(Plane=rotate_3.Geometry, XSize=number_slider_2, YSize=rampant_en_m, Radius=0)  # -> Rectangle, Length
boundary_surfaces = BoundarySurfaces(Edges=rectangle.Rectangle)
brep = Brep(boundary_surfaces)

sdivide = DivideSurface(Surface=srfgrid, UCount=10, VCount=10)  # -> Points, Normals, Parameters
panel_3 = Panel(sdivide.Points)
importepw = LBImportEPW(epw_file=file_path)  # -> location, dry_bulb_temperature, dew_point_temperature, relative_humidity, wind_speed, wind_direction, direct_normal_rad, diffuse_horizontal_rad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; plug-in component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
# Surface de mesure de la simulation, surface d'étude au centre pour limiter les effets de bord.
srf = Surface(<surface referenced from the Rhino model>)
# A quelle distance de la surface de mesure on récolte les data
number_slider_3 = Slider(0.5, range=0..1)
panel_4 = Panel("Finesse")
skymatrix = LBCumulativeSkyMatrix(location=importepw.location, direct_rad=importepw.direct_normal_rad, diffuse_rad=importepw.diffuse_horizontal_rad)  # -> report, sky_mtx; plug-in component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
# Pas forcément besoin ; peut être utile pour vérifier
sunpath = LBSunPath(location=importepw.location, scale=1)  # -> report, vectors, altitudes, azimuths, hoys, sun_pts, analemma, daily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; plug-in component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
# idéalement, récupérer min, max et moy irradiance /heure
toggle = BooleanToggle(True)
# 2 params de sortie :
# Moyenne d'irradiance horaire par point
# OU cumulé irradiance sur la surface à l'année
# 
# régler ça dans input : irradiance_
incidentradiation = LBIncidentRadiation(
    sky_mtx=skymatrix.sky_mtx,
    geometry=flatten(srf),
    context=flatten(brep),
    grid_size=Slider(1, range=0..1),
    offset_dist=number_slider_3,
    run=toggle)  # -> report, points, results, total, mesh, legend, title, int_mtx; plug-in component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
